# Grasshopper definition sardine_test.gh (Grasshopper 1.0.8)
# plug-ins: Sardine.GH

curve = Curve()
sardine_site = SardineSite(Boundary=curve, MergeAngle=Slider(0, range=0..5), MinEdgeLength=Slider(0, range=0..5))  # -> RawBoundary, WorkingBoundary, Edges, EdgeDirections, EdgeLengths, EdgeCount, Warnings
